# Grasshopper definition Team03.2 Final Assignment.gh (Grasshopper 1.0.8)

curve = Curve([<curve referenced from the Rhino model> x320])
area = Area(Geometry=curve)  # -> Area, Centroid
deconstruct = Deconstruct(Point=area.Centroid)  # -> XComponent, YComponent, ZComponent
construct_point = ConstructPoint(XCoordinate=deconstruct.XComponent, YCoordinate=deconstruct.YComponent, ZCoordinate=0)
point_groups = PointGroups(Points=construct_point, Distance=Slider(2, range=0..10))  # -> Groups, Indices
list_item = ListItem(List=curve, Index=point_groups.Indices, Wrap=True)
list_item_2 = ListItem(List=deconstruct.ZComponent, Index=point_groups.Indices, Wrap=True)
sort_list = SortList(Keys=list_item_2, ValuesValuesA=list_item)  # -> Keys, simplify(ValuesValuesA)
curve_2 = Curve(sort_list.ValuesValuesA)
explode_tree = ExplodeTree(Data=curve_2)  # -> Branch0, Branch1, Branch2, Branch3
curve_3 = Curve(explode_tree.Branch0)
curve_4 = Curve(explode_tree.Branch1)
curve_5 = Curve(explode_tree.Branch2)
curve_6 = Curve(explode_tree.Branch3)
loft = Loft(Curves=curve_3, Options={Adjust=False, Closed=False, LoftEnds=0, LoftSimp=0, LoftType=0, Rebuild=10, Refit=0.01})
loft_2 = Loft(Curves=curve_4, Options={Adjust=False, Closed=False, LoftEnds=0, LoftSimp=0, LoftType=0, Rebuild=10, Refit=0.01})
loft_3 = Loft(Curves=curve_5, Options={Adjust=False, Closed=False, LoftEnds=0, LoftSimp=0, LoftType=0, Rebuild=10, Refit=0.01})
loft_4 = Loft(Curves=curve_6, Options={Adjust=False, Closed=False, LoftEnds=0, LoftSimp=0, LoftType=0, Rebuild=10, Refit=0.01})
cap_holes = CapHoles(Brep=loft)
cap_holes_2 = CapHoles(Brep=loft_2)
cap_holes_3 = CapHoles(Brep=loft_3)
cap_holes_4 = CapHoles(Brep=loft_4)
mesh_brep = MeshBrep(
    Brep=cap_holes,
    Settings={GridMaxCount=0, GridMinCount=16, JaggedSeams=False, MaxEdgeLength=0, MinEdgeLength=0.0001, MinTolerance=0, Refine=True, RefineAngle=0, RelativeTolerance=0.65, SimplePlanes=True, Tolerance=0})
mesh_brep_2 = MeshBrep(
    Brep=cap_holes_2,
    Settings={GridMaxCount=0, GridMinCount=16, JaggedSeams=False, MaxEdgeLength=0, MinEdgeLength=0.0001, MinTolerance=0, Refine=True, RefineAngle=0, RelativeTolerance=0.65, SimplePlanes=True, Tolerance=0})
mesh_brep_3 = MeshBrep(
    Brep=cap_holes_3,
    Settings={GridMaxCount=0, GridMinCount=16, JaggedSeams=False, MaxEdgeLength=0, MinEdgeLength=0.0001, MinTolerance=0, Refine=True, RefineAngle=0, RelativeTolerance=0.65, SimplePlanes=True, Tolerance=0})
mesh_brep_4 = MeshBrep(
    Brep=cap_holes_4,
    Settings={GridMaxCount=0, GridMinCount=16, JaggedSeams=False, MaxEdgeLength=0, MinEdgeLength=0.0001, MinTolerance=0, Refine=True, RefineAngle=0, RelativeTolerance=0.65, SimplePlanes=True, Tolerance=0})
merge = Merge(Data1=mesh_brep, Data2=mesh_brep_2, Data3=mesh_brep_3, Data4=mesh_brep_4)

slab_curves = GetGeometry(AnnotationTypeFilter=3966, AtLeast=1, AtMost=1, DeleteInput=False, Filter=1074081855, TreeAccess=False)
curve_7 = Curve(slab_curves)
area_2 = Area(Geometry=curve_7)  # -> Area, Centroid
deconstruct_2 = Deconstruct(Point=area_2.Centroid)  # -> XComponent, YComponent, ZComponent
construct_point_2 = ConstructPoint(XCoordinate=deconstruct_2.XComponent, YCoordinate=deconstruct_2.YComponent, ZCoordinate=0)
point_groups_2 = PointGroups(Points=construct_point_2, Distance=Slider(2, range=0..10))  # -> Groups, Indices
list_item_3 = ListItem(List=curve_7, Index=point_groups_2.Indices, Wrap=True)
list_item_4 = ListItem(List=deconstruct_2.ZComponent, Index=point_groups_2.Indices, Wrap=True)
sort_list_2 = SortList(Keys=list_item_4, ValuesA=list_item_3)  # -> Keys, simplify(ValuesA)
curve_8 = Curve(sort_list_2.ValuesA)
explode_tree_2 = ExplodeTree(Data=curve_8)  # -> Branch0, Branch1, Branch2, Branch3
curve_9 = Curve(explode_tree_2.Branch0)
curve_10 = Curve(explode_tree_2.Branch1)
curve_11 = Curve(explode_tree_2.Branch2)
curve_12 = Curve(explode_tree_2.Branch3)
loft_5 = Loft(Curves=curve_9, Options={Adjust=False, Closed=False, LoftEnds=0, LoftSimp=0, LoftType=0, Rebuild=10, Refit=0.01})
cap_holes_5 = CapHoles(Brep=loft_5)
mesh_brep_5 = MeshBrep(
    Brep=cap_holes_5,
    Settings={GridMaxCount=0, GridMinCount=16, JaggedSeams=False, MaxEdgeLength=0, MinEdgeLength=0.0001, MinTolerance=0, Refine=True, RefineAngle=0, RelativeTolerance=0.65, SimplePlanes=True, Tolerance=0})

loft_6 = Loft(Curves=curve_10, Options={Adjust=False, Closed=False, LoftEnds=0, LoftSimp=0, LoftType=0, Rebuild=10, Refit=0.01})
loft_7 = Loft(Curves=curve_11, Options={Adjust=False, Closed=False, LoftEnds=0, LoftSimp=0, LoftType=0, Rebuild=10, Refit=0.01})
loft_8 = Loft(Curves=curve_12, Options={Adjust=False, Closed=False, LoftEnds=0, LoftSimp=0, LoftType=0, Rebuild=10, Refit=0.01})
cap_holes_6 = CapHoles(Brep=loft_6)
cap_holes_7 = CapHoles(Brep=loft_7)
cap_holes_8 = CapHoles(Brep=loft_8)
mesh_brep_6 = MeshBrep(
    Brep=cap_holes_6,
    Settings={GridMaxCount=0, GridMinCount=16, JaggedSeams=False, MaxEdgeLength=0, MinEdgeLength=0.0001, MinTolerance=0, Refine=True, RefineAngle=0, RelativeTolerance=0.65, SimplePlanes=True, Tolerance=0})
mesh_brep_7 = MeshBrep(
    Brep=cap_holes_7,
    Settings={GridMaxCount=0, GridMinCount=16, JaggedSeams=False, MaxEdgeLength=0, MinEdgeLength=0.0001, MinTolerance=0, Refine=True, RefineAngle=0, RelativeTolerance=0.65, SimplePlanes=True, Tolerance=0})
mesh_brep_8 = MeshBrep(
    Brep=cap_holes_8,
    Settings={GridMaxCount=0, GridMinCount=16, JaggedSeams=False, MaxEdgeLength=0, MinEdgeLength=0.0001, MinTolerance=0, Refine=True, RefineAngle=0, RelativeTolerance=0.65, SimplePlanes=True, Tolerance=0})
merge_2 = Merge(Data1=mesh_brep_5, Data2=mesh_brep_6, Data3=mesh_brep_7, Data4=mesh_brep_8)

# ----
# RADIATION
context_bake = ContextBake(Content=merge_2)
