# Grasshopper definition test_minimal.ghx (Grasshopper 1.0.8)

curves = GetGeometry(AnnotationTypeFilter=3966, AtLeast=1, AtMost=1, DeleteInput=False, Filter=1074081855, TreeAccess=False)
graft_tree = GraftTree(Tree=curves, IncludeEmptyLists=True, IncludeNullItems=True)
pipe = Pipe(Curve=graft_tree, Radius=Slider(0.5, range=0..1), Caps=2, FitRail=False)
mesh_brep = MeshBrep(
    Brep=pipe,
    Settings={GridMaxCount=0, GridMinCount=16, JaggedSeams=False, MaxEdgeLength=0, MinEdgeLength=0.0001, MinTolerance=0, Refine=True, RefineAngle=0, RelativeTolerance=0.65, SimplePlanes=True, Tolerance=0})
mesh = Geometry(flatten(mesh_brep))
context_bake = ContextBake(Content=mesh)
